# Grasshopper definition unnamed.gh (Grasshopper 1.0.8)

reset = Boolean()
run = Boolean()
# FIX Reset button. Ensure that when you run it resets
cr = Curve()
py3 = Python3Script(reset=reset, run=run, cr=cr)  # -> out, b, EdgeLengthFactor, LineLengthStrength, LineLengthFactor, LoadFactor, reset, run, dbg; inputs cr: list
# ---------- py3: Python ----------
import Rhino
import json
from System.Net import WebClient

URL = "http://localhost:3001/api/compute/params"


def _unwrap_curve(obj):
    if obj is None:
        return None

    try:
        if isinstance(obj, Rhino.Geometry.Curve):
            return obj
    except:
        pass

    try:
        v = getattr(obj, "Value", None)
        if v is not None:
            try:
                if isinstance(v, Rhino.Geometry.Curve):
                    return v
            except:
                pass
    except:
        pass

    try:
        v = getattr(obj, "Curve", None)
        if v is not None:
            try:
                if isinstance(v, Rhino.Geometry.Curve):
                    return v
            except:
                pass
    except:
        pass

    return None


def _is_valid_curve(c):
    if c is None:
        return False
    try:
        return bool(c.IsValid)
    except:
        return True


def _sanitize_curve(c):
    if c is None:
        return None

    try:
        if c.IsValid:
            return c
    except:
        return c

    try:
        cc = c.DuplicateCurve()
        if cc is not None and cc.IsValid:
            return cc
    except:
        pass

    try:
        nc = c.ToNurbsCurve()
        if nc is not None and nc.IsValid:
            return nc
    except:
        pass

    try:
        pl = Rhino.Geometry.Polyline()
        if c.TryGetPolyline(pl):
            pc = Rhino.Geometry.PolylineCurve(pl)
            if pc is not None and pc.IsValid:
                return pc
    except:
        pass

    return None


def _decode_curve_item(it):
    c = _unwrap_curve(it)
    if c:
        sc = _sanitize_curve(c)
        if sc:
            return sc

    if isinstance(it, dict):
        rh_json = it.get("data", None)
        if rh_json is None:
            return None

        if isinstance(rh_json, str):
            # 1) direct FromJSON on the raw string payload
            try:
                obj = Rhino.Runtime.CommonObject.FromJSON(rh_json)
                c = _unwrap_curve(obj)
                sc = _sanitize_curve(c)
                if sc:
                    return sc
            except:
                pass

            # 2) fallback: loads -> dumps
            try:
                geom_dict = json.loads(rh_json)
                obj = Rhino.Runtime.CommonObject.FromJSON(json.dumps(geom_dict))
                c = _unwrap_curve(obj)
                sc = _sanitize_curve(c)
                if sc:
                    return sc
            except:
                pass

            return None

        # rh_json already dict-like
        try:
            obj = Rhino.Runtime.CommonObject.FromJSON(json.dumps(rh_json))
            c = _unwrap_curve(obj)
            sc = _sanitize_curve(c)
            if sc:
                return sc
        except:
            pass

        return None

    if isinstance(it, str):
        try:
            obj = Rhino.Runtime.CommonObject.FromJSON(it)
            c = _unwrap_curve(obj)
            sc = _sanitize_curve(c)
            if sc:
                return sc
        except:
            pass

        try:
            geom_dict = json.loads(it)
            obj = Rhino.Runtime.CommonObject.FromJSON(json.dumps(geom_dict))
            c = _unwrap_curve(obj)
            sc = _sanitize_curve(c)
            if sc:
                return sc
        except:
            pass

        return None

    return None


def _decode_many(val):
    out_list = []
    try:
        if val is None:
            return out_list

        # DataTree/Array/IEnumerable
        try:
            for it in val:
                c = _decode_curve_item(it)
                if c:
                    out_list.append(c)
            if out_list:
                return out_list
        except:
            pass

        # single item
        c = _decode_curve_item(val)
        if c:
            out_list.append(c)
        return out_list
    except:
        return []


def _coerce_number(v):
    try:
        if isinstance(v, bool):
            return None
        if isinstance(v, (int, float)):
            return float(v)
        if isinstance(v, str):
            return float(v)
    except:
        return None
    return None


def _coerce_bool(v):
    try:
        if isinstance(v, bool):
            return v
        if isinstance(v, str):
            s = v.strip().lower()
            if s == "true":
                return True
            if s == "false":
                return False
    except:
        return None
    return None


# Default values if this file is executed outside of GH Python component context
try:
    edge
except NameError:
    edge = 0.001
try:
    lineStrength
except NameError:
    lineStrength = 16.0
try:
    lineFactor
except NameError:
    lineFactor = 1.0
try:
    load
except NameError:
    load = 5.0
try:
    reset
except NameError:
    reset = False
try:
    run
except NameError:
    run = True
try:
    cr
except NameError:
    cr = None


# ============================================================
# 1) READ STORE FROM WEB
# ============================================================
store = None
store_err = None
try:
    wc = WebClient()
    wc.Headers.Add("Accept", "application/json")
    s = wc.DownloadString(URL)
    store = json.loads(s)
except Exception as e:
    store_err = str(e)
    store = None

# ============================================================
# 2) PARAMS FROM WEB (fallback to GH inputs)
# ============================================================
web_edge = None
web_lineStrength = None
web_lineFactor = None
web_load = None
web_reset = None
web_run = None
web_cr_raw = None

if isinstance(store, dict):
    web_edge = _coerce_number(store.get("edge", None))
    web_lineStrength = _coerce_number(store.get("lineStrength", None))
    web_lineFactor = _coerce_number(store.get("lineFactor", None))
    web_load = _coerce_number(store.get("load", None))
    web_reset = _coerce_bool(store.get("reset", None))
    web_run = _coerce_bool(store.get("run", None))
    web_cr_raw = store.get("cr", None)

edge_val = web_edge if web_edge is not None else edge
lineStrength_val = web_lineStrength if web_lineStrength is not None else lineStrength
lineFactor_val = web_lineFactor if web_lineFactor is not None else lineFactor
load_val = web_load if web_load is not None else load
reset_val = web_reset if web_reset is not None else reset
run_val = web_run if web_run is not None else run

# ============================================================
# 3) CURVES (PRIORITY): input cr -> store cr -> default
# ============================================================
used_input_cr = False
used_store = False
used_default = False

curves_in = _decode_many(cr)
if curves_in:
    used_input_cr = True
    web_curves = curves_in
else:
    curves_store = _decode_many(web_cr_raw)
    if curves_store:
        used_store = True
        web_curves = curves_store
    else:
        web_curves = []

if not web_curves:
   reset = True

# GH outputs (when pasted into GH Python)
b = web_curves

# ============================================================
# 4) PASS THROUGH OUTPUTS
# ============================================================
EdgeLengthFactor = edge_val
# EdgeLengthFactor = 0.01

LineLengthStrength = lineStrength_val
# LineLengthStrength = 8

LineLengthFactor = lineFactor_val
LoadFactor = load_val
# LoadFactor = 2.2

reset = reset_val
run = run_val

out = "OK"

valid_count = 0
try:
    for cc in web_curves:
        try:
            if cc and cc.IsValid:
                valid_count += 1
        except:
            pass
except:
    valid_count = None

store_decoded = 0
try:
    if isinstance(web_cr_raw, list):
        for it in web_cr_raw:
            if _decode_curve_item(it):
                store_decoded += 1
except:
    pass

try:
    store_cr_first_keys = list(web_cr_raw[0].keys()) if isinstance(web_cr_raw, list) and len(web_cr_raw) else None
    store_cr_first_type = type(web_cr_raw[0]).__name__ if isinstance(web_cr_raw, list) and len(web_cr_raw) else None
except:
    store_cr_first_keys = None
    store_cr_first_type = None

decode_err0 = None
decode_obj0_type = None
decode_curve0_type = None
decode_curve0_valid = None
decode_curve0_sanitized = None
try:
    if isinstance(web_cr_raw, list) and len(web_cr_raw):
        it0 = web_cr_raw[0]
        rh0 = it0.get("data", None) if isinstance(it0, dict) else None
        if isinstance(rh0, str):
            try:
                obj0 = Rhino.Runtime.CommonObject.FromJSON(rh0)
                decode_obj0_type = type(obj0).__name__ if obj0 is not None else None
                c0 = _unwrap_curve(obj0)
                c0s = _sanitize_curve(c0)
                decode_curve0_sanitized = c0s is not None
                decode_curve0_type = type(c0s).__name__ if c0s is not None else (type(c0).__name__ if c0 is not None else None)
                try:
                    decode_curve0_valid = bool(c0s.IsValid) if c0s is not None else (bool(c0.IsValid) if c0 is not None else None)
                except:
                    decode_curve0_valid = None
            except Exception as e:
                decode_err0 = str(e)
except:
    pass

dbg = {
    "url": URL,
    "store_ok": store is not None,
    "store_err": store_err,
    "store_has_cr": isinstance(web_cr_raw, list),
    "store_cr_len": len(web_cr_raw) if isinstance(web_cr_raw, list) else None,
    "store_decoded": store_decoded,
    "store_cr_first_type": store_cr_first_type,
    "store_cr_first_keys": store_cr_first_keys,
    "decode_err0": decode_err0,
    "decode_obj0_type": decode_obj0_type,
    "decode_curve0_type": decode_curve0_type,
    "decode_curve0_valid": decode_curve0_valid,
    "decode_curve0_sanitized": decode_curve0_sanitized,
    "curves": len(web_curves) if web_curves else 0,
    "valid_curves": valid_count,
    "used_store": used_store,
    "used_input_cr": used_input_cr,
    "used_default": used_default,
    "edge_val": edge_val,
    "lineStrength_val": lineStrength_val,
    "lineFactor_val": lineFactor_val,
    "load_val": load_val,
    "reset_val": reset_val,
    "run_val": run_val,
}

dbg = json.dumps(dbg, ensure_ascii=False)
# ---------- end py3 ----------
crv = Curve(py3.b)
join = JoinCurves(Curves=crv, Preserve=False)
simplify = SimplifyCurve(Curve=join)  # -> Curve, Simplified
crv_2 = Curve(simplify.Curve)
cluster = Cluster(C_3=crv_2, d3=crv_2, C=crv_2, L=crv_2, crv_3=crv_2, C_2=crv_2, crv_5=crv_2)  # -> pt_5, mesh_5, line_7, pt_14, pt_13, number_slider
cluster_2 = Cluster_2(
    G=cluster.mesh_5,
    mesh=cluster.mesh_5,
    lengthfactor=py3.EdgeLengthFactor,
    C=cluster.line_7,
    line=cluster.line_7,
    B=py3.LineLengthFactor,
    strength=py3.LineLengthStrength,
    M=cluster.mesh_5,
    P=cluster.pt_14,
    pt=cluster.pt_5,
    T=cluster.pt_13,
    F=cluster.number_slider,
    crv=[<geometry referenced from the Rhino model> x25],
    F_2=py3.LoadFactor)
bouncysolver = BouncySolver(GoalObjects=cluster_2, Reset=py3.reset, Threshold=1e-15, Tolerance=0.0001, Damping=0.99, Iterations=10, On=py3.run)  # -> I, V, O
py3_2 = Python3Script(V=bouncysolver.V, M_template=cluster.mesh_5, run=py3.run, reset=py3.reset, eps="0.001", stableN="50")  # -> out, a, b, c, d, e, f; inputs V: list of Point3d, M_template: Mesh, run: Boolean, reset: Boolean, eps: Double, stableN: Int32
# ---------- py3_2: Python ----------
"""
ConvergenceGateMesh – fixed version for GH_Point inputs
Extended with explicit output contract:
a = RH_OUT
b = RH_READY
c = maxDelta
d = stableCount
e = RH_STATUS
f = RH_META
"""

import Rhino
import scriptcontext as sc
import json

# ---- default params ----
if eps is None: eps = 0.001
if stableN is None: stableN = 30
if run is None: run = True
if reset is None: reset = False

KEY = "ConvergenceGateMesh_v2"

# ---------- helpers ----------
def toPoint3d(p):
    """Convert GH_Point or other types to Rhino Point3d"""
    if hasattr(p, "Value"):
        return p.Value
    if isinstance(p, Rhino.Geometry.Point3d):
        return p
    return Rhino.Geometry.Point3d(p)

def copyMeshWithVertices(template, pts):
    m = template.DuplicateMesh()

    if m.Vertices.Count != len(pts):
        raise Exception("Vertex count mismatch")

    for i, p in enumerate(pts):
        m.Vertices.SetVertex(i, p)

    m.UnifyNormals()
    m.Normals.ComputeNormals()
    m.Compact()

    return m

def clearState():
    if KEY in sc.sticky:
        del sc.sticky[KEY]

def getState():
    if KEY not in sc.sticky:
        sc.sticky[KEY] = {
            "prev": None,
            "stable": 0,
            "frozen": None
        }
    return sc.sticky[KEY]

def mesh_counts(m):
    if m is None:
        return (0, 0)
    try:
        return (m.Vertices.Count, m.Faces.Count)
    except:
        return (0, 0)

# ---------- init ----------
status = "idle"
error_msg = None

# ---------- reset ----------
if reset:
    clearState()

state = getState()

isStable = False
stableMesh = state["frozen"]
stableCount = state["stable"]
maxDelta = 0.0

# ---------- if mesh already frozen ----------
if state["frozen"] is not None:
    isStable = True
    stableMesh = state["frozen"]
    status = "ready"

# ---------- compute convergence ----------
elif run and V and M_template:
    try:
        pts = [toPoint3d(p) for p in V]
        prev = state["prev"]

        if prev is None or len(prev) != len(pts):
            state["prev"] = pts
            state["stable"] = 0
            status = "running"

        else:
            maxDelta = 0.0

            for i in range(len(pts)):
                d0 = pts[i].DistanceTo(prev[i])
                if d0 > maxDelta:
                    maxDelta = d0

            if maxDelta < eps:
                state["stable"] += 1
            else:
                state["stable"] = 0

            state["prev"] = pts
            status = "waiting_for_convergence"

        stableCount = state["stable"]

        # freeze mesh
        if stableCount >= stableN:
            frozen = copyMeshWithVertices(M_template, pts)
            state["frozen"] = frozen
            stableMesh = frozen
            isStable = True
            status = "ready"

    except Exception as ex:
        error_msg = str(ex)
        status = "error"
        stableMesh = None
        isStable = False

# ---------- non-running / reset states ----------
elif reset:
    status = "reset"

elif not run:
    if stableMesh is not None:
        isStable = True
        status = "ready"
    else:
        status = "idle"

else:
    # Covers missing V or M_template while run is True
    status = "waiting_for_convergence"

# ---------- output contract ----------
# RH_OUT should only be populated when ready
if isStable and stableMesh is not None:
    a = stableMesh
else:
    a = None

# RH_READY
b = bool(isStable and stableMesh is not None)

# existing debug values
c = maxDelta
d = stableCount

# RH_STATUS
e = status

# RH_META
v_count, f_count = mesh_counts(stableMesh)
meta = {
    "stableCount": stableCount,
    "maxDelta": maxDelta,
    "hasFrozen": state["frozen"] is not None,
    "vertexCount": v_count,
    "faceCount": f_count,
    "run": bool(run),
    "reset": bool(reset),
    "eps": eps,
    "stableN": stableN,
    "error": error_msg,
    "message": status
}
f = json.dumps(meta, ensure_ascii=False)
# ---------- end py3_2 ----------
rh_status = Panel(py3_2.e)
rh_meta = Panel(py3_2.f)
rh_ready = Boolean(py3_2.b)
rh_out = Mesh(py3_2.a)

# ---- group: User_Input
edgelengthfactor = Slider(0.01, range=0..0.01)
linelengthfactor = Slider(0.5, range=0..3)
linelengthstrength = Slider(8, range=0..20)
loadfactor = Slider(7.88365, range=0..40.04001)
reset_2 = Button()
run_2 = BooleanToggle(False)

# ==== cluster Cluster
panel = Panel(""".2
-.2""")
C = ClusterInput()
C_2 = ClusterInput()
explode = Explode(Curve=C, Recursive=True)  # -> flatten(Segments), Vertices
offset = OffsetCurve(Curve=graft(C_2), Distance=panel, Corners=1)
L = ClusterInput()
mcx = MultipleCurves(Curves=explode.Segments)  # -> Points, IndexA, IndexB, ParamA, ParamB
trim = TrimTree(Tree=offset, Depth=1)
lng = ListLength(List=L)
d3 = ClusterInput()
loft = Loft(Curves=trim, Options={Adjust=False, Closed=False, LoftEnds=0, LoftSimp=0, LoftType=0, Rebuild=10, Refit=0.01})
merge = Merge(Data1=mcx.ParamA, Data2=mcx.ParamB)
series = Series(Start=0, Step=1, Count=lng)
merge_2 = Merge(Data1=mcx.IndexA, Data2=mcx.IndexB, Data3=d3)  # -> flatten(Result)
crv = Curve(loft)
equals = Equality(FirstNumber=merge_2, SecondNumber=graft(series))  # -> Equality, Inequality
runion = RegionUnion(Curves=flatten(crv))
dispatch = Dispatch(List=merge, DispatchPattern=equals.Equality)  # -> ListA, ListB
C_3 = ClusterInput()
boundary = BoundarySurfaces(Edges=runion)
shatter = Shatter(Curve=graft(C_3), Parameters=dispatch.ListA)
custom_mesh_settings = SettingsCustom(
    StitchSeams=True,
    SimplePlanes=False,
    Refine=True,
    MinCount=16,
    MaxCount=400,
    AspectRatio=20,
    MaxDistance=0,
    MaxAngle=20,
    MinEdge=".2",
    MaxEdge=".2")
srf = Surface(boundary)
crv_2 = Curve(shatter)
end = EndPoints(Curve=crv_2)  # -> Start, End
debrep = DeconstructBrep(Brep=srf)  # -> Faces, Edges, Vertices
mesh = MeshBrep(Brep=srf, Settings=custom_mesh_settings)
pt = Point(flatten([end.End, end.Start]))
pgroups = PointGroups(Points=pt, Distance=Slider(0.01, range=0..0.01))  # -> Groups, Indices
pt_2 = Point(pgroups.Groups)
prune = PruneTree(Tree=pt_2, Minimum="2", Maximum="10")
item = ListItem(List=prune, Index=0, Wrap=True)
lng_2 = ListLength(List=prune)
pt_3 = Point(item)
pt_4 = Point(debrep.Vertices)
pt_5 = ClusterOutput(pt_3)
cps = ClosestPoints(Point=pt_3, Cloud=pt_4, Count=lng_2)  # -> ClosestPoint, CPIndex, Distance
pt_6 = Point(cps.ClosestPoint)
ln = Line(StartPoint=pt_3, EndPoint=pt_6)
line = Line(ln)
crv_3 = ClusterInput()
crv_4 = Curve([line, crv_3])
srf_2 = Surface(srf)
srfsplit = SurfaceSplit(Surface=srf_2, Curves=flatten(crv_4))
brep = Brep(srfsplit)
smesh = SimpleMesh(Brep=brep)
mjoin = MeshJoin(Meshes=smesh)
weldvertices = MeshWeldVertices(Mesh=mjoin, Tolerance=0.01)  # -> RuntimeMessage, Mesh
unifynormals = MeshUnifyNormals(Mesh=weldvertices.Mesh)
mesh_2 = Mesh(unifynormals)
refine = Refine(Mesh=mesh_2, Level="3")
crv_5 = ClusterInput()
mesh_3 = Mesh(refine)
srf_3 = Surface(srf_2)
crv_6 = Curve(crv_5)
end_2 = EndPoints(Curve=crv_6)  # -> Start, End
debrep_2 = DeconstructBrep(Brep=srf_3)  # -> Faces, Edges, Vertices
nv = NakedVertices(Mesh=mesh_3)  # -> ClothedIndex, NakedIndex, ClothedPts, NakedPts
line_2 = Line(debrep_2.Edges)
midpt = CurveMiddle(Curve=line_2)
pt_7 = Point(midpt)
pt_8 = Point([end_2.End, end_2.Start])
cp = ClosestPoint(Point=simplify(graft(pt_8)), Cloud=pt_7)  # -> ClosestPoint, CPIndex, Distance
item_2 = ListItem(List=line_2, Index=cp.CPIndex, Wrap=True)
pt_9 = Point(nv.NakedPts)
line_3 = Line(item_2)
pull = PullPoint(Point=pt_9, Geometry=line_3, ClosestOnly=True)  # -> ClosestPoint, Distance, Index
smaller = SmallerThan(FirstNumber=pull.Distance, SecondNumber=Slider(0.01, range=0..0.01))  # -> SmallerThan, OrEqualTo
dispatch_2 = Dispatch(List=pt_9, DispatchPattern=smaller.SmallerThan)  # -> ListA, ListB
line_4 = Line(line_3)
midpt_2 = CurveMiddle(Curve=line_4)
len = Length(Curve=line_4)
division = Division(A=len, B="2")
cir = Circle(Plane=midpt_2, Radius=division)
ccx = CurveCurve(CurveA=line_4, CurveB=cir)  # -> Points, ParamsA, ParamsB
shatter_2 = Shatter(Curve=graft(cir), Parameters=ccx.ParamsB)  # -> simplify(Segments)
line_5 = Line(line_4)
curvepoint = PointOnCurve(shatter_2, parameter=0.024)
srf_4 = Surface(srf_3)
end_3 = EndPoints(Curve=line_5)  # -> Start, End
brep_cp = BrepClosestPoint(Point=curvepoint, Brep=srf_4)  # -> Point, Normal, Distance
sort = SortList(Keys=brep_cp.Distance, ValuesA=shatter_2)  # -> Keys, ValuesA
item_3 = ListItem(List=sort.ValuesA, Index="1", Wrap=True)
crv_7 = Curve(item_3)
end_4 = EndPoints(Curve=crv_7)  # -> Start, End
dist = Distance(PointA=end_4.Start, PointB=end_3.Start)
equals_2 = Equality(FirstNumber=dist, SecondNumber="0")  # -> Equality, Inequality
panel_2 = Panel(equals_2.Equality)
dispatch_3 = Dispatch(List=line_5, DispatchPattern=equals_2.Equality)  # -> ListA, ListB
pt_10 = Point(dispatch_2.ListA)
lng_3 = ListLength(List=pt_10)
subtraction = Subtraction(A=lng_3, B=Slider(1, range=0..1))
flip = FlipCurve(Curve=dispatch_3.ListB)  # -> Curve, Flag
divide = DivideCurve(Curve=crv_7, Count=subtraction, Kinks=False)  # -> Points, Tangents, Parameters
merge_3 = Merge(Data1=dispatch_3.ListA, Data2=flip.Curve)
mesh_4 = Mesh(mesh_3)
crv_8 = Curve(merge_3)
medges = MeshEdges(Mesh=mesh_4)  # -> NakedEdges, InteriorEdges, NonManifoldEdges
alongcrv = SortAlongCurve(Points=pt_10, Curve=crv_8)  # -> Points, Indices
pt_11 = Point(divide.Points)
mesh_5 = ClusterOutput(mesh_4)
pt_12 = Point(alongcrv.Points)
line_6 = Line(medges.NakedEdges)
pt_13 = ClusterOutput(pt_11)
pt_14 = ClusterOutput(pt_12)
line_7 = ClusterOutput(line_6)
number_slider = ClusterOutput(Slider(0.01289, range=0..0.04001))

# ==== cluster Cluster_2
M = ClusterInput()
F = ClusterInput()
pt = ClusterInput()
demesh = DeconstructMesh(Mesh=M)  # -> Vertices, Faces, Colours, Normals
Z = UnitZ(Factor=F)
C = ClusterInput()
pt_2 = Point(pt)
len = Length(Curve=C)
rev = Reverse(Vector=Z)
P = ClusterInput()
T = ClusterInput()
B = ClusterInput()
anchor = Anchor(Point=P, Target=T, Strength=10000)
F_2 = ClusterInput()
multiplication = Multiplication(A=len, B=B)
mesh = ClusterInput()
lengthfactor = ClusterInput()
crv = ClusterInput()
line = ClusterInput()
strength = ClusterInput()
G = ClusterInput()
Z_2 = UnitZ(Factor=F_2)
load = Load(Point=pt_2, ForceVector=rev, Weighting=1)
edgelengths = EdgeLengths(Mesh=mesh, LengthFactor=lengthfactor, Strength=1)
crv_2 = Curve(crv)
length_line = LengthLine(Line=line, Length=multiplication, Strength=strength)
load_2 = Load(Point=demesh.Vertices, ForceVector=Z_2, Weighting=1)
show = Show(G=G)
relay = Relay()
merge = Merge(Data1=show, Data2=edgelengths, Data3=load_2, Data4=anchor, Data5=length_line, Data6=load, Data7=relay)
R = ClusterOutput(merge)
