# Grasshopper definition unnamedC.gh (Grasshopper 1.0.8)

# ---- group: RH_IN:OSM_GEOJSON
osm_geojson = Text("{\"type\":\"FeatureCollection\",\"features\":[ ... ]}")

# ----
py3 = Python3Script(OSM_GEOJSON=osm_geojson)  # -> geo, dbg
# ---------- py3: Python ----------
import Rhino
import json
import math
import os
import urllib.request

# INPUTS:
# - OSM_GEOJSON (Text) optional: GeoJSON FeatureCollection string OR URL/path to a .geojson/.json file
#
# OUTPUTS:
# - geo (List[Geometry]): curves + breps + meshes
# - dbg (Text JSON with stats)

EARTH_R = 6378137.0
DEG2RAD = math.pi / 180.0

def _coerce_str(v):
    try:
        if v is None:
            return None
        if isinstance(v, str):
            s = v.strip()
            return s if s else None
        return str(v)
    except Exception:
        return None

def _as_float(v):
    try:
        return float(v)
    except Exception:
        return None

def _load_geojson_text(v):
    s = _coerce_str(v)
    if not s:
        return None, None, 'empty'

    # URL
    if s.startswith('http://') or s.startswith('https://'):
        try:
            with urllib.request.urlopen(s) as resp:
                b = resp.read()
            try:
                return b.decode('utf-8'), 'url', None
            except Exception:
                return b.decode('utf-8', errors='replace'), 'url', None
        except Exception as e:
            return None, 'url', 'url_read_error: ' + str(e)

    # Local file path
    try:
        if os.path.exists(s) and os.path.isfile(s):
            with open(s, 'r', encoding='utf-8') as f:
                return f.read(), 'path', None
    except Exception as e:
        return None, 'path', 'file_read_error: ' + str(e)

    # Fall back: treat as inline JSON
    return s, 'inline', None

def _decode_feature_collection(v):
    s, src, load_err = _load_geojson_text(v)
    if load_err:
        return None, (src or 'unknown'), load_err
    if not s:
        return None, (src or 'unknown'), 'empty'
    try:
        obj = json.loads(s)
    except Exception as e:
        return None, (src or 'unknown'), 'json_parse_error: ' + str(e)
    if not isinstance(obj, dict):
        return None, (src or 'unknown'), 'not_a_dict'
    if obj.get('type') != 'FeatureCollection':
        return None, (src or 'unknown'), 'not_feature_collection'
    feats = obj.get('features', None)
    if not isinstance(feats, list):
        return None, (src or 'unknown'), 'features_not_list'
    return feats, (src or 'unknown'), None

def _iter_lonlat_coords(geom):
    # yields (lon, lat) pairs from any GeoJSON geometry
    if not isinstance(geom, dict):
        return
    t = geom.get('type')
    c = geom.get('coordinates')
    if not t or c is None:
        return
    def walk(x):
        if isinstance(x, (list, tuple)):
            if len(x) >= 2 and isinstance(x[0], (int, float)) and isinstance(x[1], (int, float)):
                yield (float(x[0]), float(x[1]))
            else:
                for it in x:
                    for p in walk(it):
                        yield p
    for p in walk(c):
        yield p

def _lonlat_to_xy(lon, lat, lon0, lat0):
    # local tangent plane approximation (meters)
    x = (lon - lon0) * DEG2RAD * EARTH_R * math.cos(lat0 * DEG2RAD)
    y = (lat - lat0) * DEG2RAD * EARTH_R
    return x, y

def _coords_to_polyline(coords, lon0, lat0, z=0.0, close=False):
    if not isinstance(coords, list) or len(coords) < 2:
        return None
    pts = []
    for p in coords:
        if not isinstance(p, (list, tuple)) or len(p) < 2:
            continue
        lon = _as_float(p[0])
        lat = _as_float(p[1])
        if lon is None or lat is None:
            continue
        x, y = _lonlat_to_xy(lon, lat, lon0, lat0)
        pts.append(Rhino.Geometry.Point3d(x, y, float(z)))
    if close and len(pts) >= 3:
        if pts[0].DistanceTo(pts[-1]) > 1e-6:
            pts.append(pts[0])
    if len(pts) < 2:
        return None
    pl = Rhino.Geometry.Polyline(pts)
    return pl.ToNurbsCurve()

def _get_height_m(props):
    if not isinstance(props, dict):
        return 0.0
    # priority: explicit height, then levels*3m
    h = props.get('height')
    if h is not None:
        try:
            return max(0.0, float(str(h).replace('m','').strip()))
        except Exception:
            pass
    levels = props.get('building:levels') or props.get('levels')
    if levels is not None:
        try:
            lv = float(str(levels).strip())
            if lv > 0:
                return lv * 3.0
        except Exception:
            pass
    return 0.0

def _extrude_curve_to_brep(crv, height):
    try:
        if crv is None or height is None or height <= 0:
            return None
        if not crv.IsClosed:
            return None
        ext = Rhino.Geometry.Extrusion.Create(crv, float(height), True)
        if ext is None:
            return None
        return ext.ToBrep()
    except Exception:
        return None

def _brep_to_mesh(brep):
    try:
        if brep is None:
            return None
        mp = Rhino.Geometry.MeshingParameters.Default
        meshes = Rhino.Geometry.Mesh.CreateFromBrep(brep, mp)
        if not meshes:
            return None
        m = Rhino.Geometry.Mesh()
        for mm in meshes:
            if mm is not None:
                m.Append(mm)
        try:
            m.Normals.ComputeNormals()
            m.Compact()
        except Exception:
            pass
        return m
    except Exception:
        return None

# Safe default if GH didn't provide inputs
try:
    OSM_GEOJSON
except NameError:
    OSM_GEOJSON = None

features, src, err = _decode_feature_collection(OSM_GEOJSON)

# choose local origin from all coords
lon0 = 0.0
lat0 = 0.0
coord_n = 0
if isinstance(features, list):
    for f in features:
        if not isinstance(f, dict):
            continue
        g = f.get('geometry')
        for lon, lat in _iter_lonlat_coords(g):
            lon0 += lon
            lat0 += lat
            coord_n += 1
if coord_n > 0:
    lon0 /= float(coord_n)
    lat0 /= float(coord_n)

geom_counts = {}
building_count = 0
curve_count = 0
brep_count = 0
mesh_count = 0

out = []
if isinstance(features, list):
    for f in features:
        if not isinstance(f, dict):
            continue
        geom = f.get('geometry')
        props = f.get('properties')
        gtype = geom.get('type') if isinstance(geom, dict) else None
        if isinstance(gtype, str) and gtype:
            geom_counts[gtype] = geom_counts.get(gtype, 0) + 1
        is_building = isinstance(props, dict) and (props.get('building') or props.get('building:part') or props.get('building:use'))
        if is_building:
            building_count += 1
        h = _get_height_m(props)

        try:
            coords = geom.get('coordinates') if isinstance(geom, dict) else None
            if gtype == 'LineString' and isinstance(coords, list):
                crv = _coords_to_polyline(coords, lon0, lat0, 0.0, False)
                if crv is not None:
                    out.append(crv)
                    curve_count += 1

            elif gtype == 'Polygon' and isinstance(coords, list) and len(coords) > 0:
                # exterior ring only for now
                ring = coords[0] if isinstance(coords[0], list) else None
                crv = _coords_to_polyline(ring, lon0, lat0, 0.0, True)
                if crv is not None:
                    out.append(crv)
                    curve_count += 1
                    if is_building and h > 0:
                        brep = _extrude_curve_to_brep(crv, h)
                        if brep is not None:
                            out.append(brep)
                            brep_count += 1
                            m = _brep_to_mesh(brep)
                            if m is not None:
                                out.append(m)
                                mesh_count += 1

            elif gtype == 'MultiPolygon' and isinstance(coords, list):
                for poly in coords:
                    if not isinstance(poly, list) or len(poly) < 1:
                        continue
                    ring = poly[0] if isinstance(poly[0], list) else None
                    crv = _coords_to_polyline(ring, lon0, lat0, 0.0, True)
                    if crv is None:
                        continue
                    out.append(crv)
                    curve_count += 1
                    if is_building and h > 0:
                        brep = _extrude_curve_to_brep(crv, h)
                        if brep is not None:
                            out.append(brep)
                            brep_count += 1
                            m = _brep_to_mesh(brep)
                            if m is not None:
                                out.append(m)
                                mesh_count += 1
        except Exception:
            # ignore per-feature errors
            pass

geo = out
dbg = json.dumps({
    'has_OSM_GEOJSON': OSM_GEOJSON is not None,
    'source': src,
    'feature_count': len(features) if isinstance(features, list) else 0,
    'geometry_types': geom_counts,
    'building_count': building_count,
    'curve_count': curve_count,
    'brep_count': brep_count,
    'mesh_count': mesh_count,
    'origin_lonlat': [lon0, lat0] if coord_n > 0 else None,
    'err': err,
}, ensure_ascii=False)
# ---------- end py3 ----------
panel = Panel(py3.dbg)
geo = Geometry(py3.geo)
